# Grasshopper definition Original - Copia.gh (Grasshopper 1.0.7)
# Copyright: © 2017-2018 Pierre Cuvilliers, Caitlin Mueller, Massachusetts Institute of Technology
# plug-ins: GHEnergyPlus, LunchBox, Opossum2_0_Proto_A

# ---- group: Choose Input folder index
panel = Panel("0")

# ----
num = Number(20)

# ---- group: Aqui calcula a porcentagem
porcentagem = B(60)
multiplication = Multiplication(A=num, B=porcentagem)
division = Division(A=multiplication, B=100)
int = Integer(expr("Round(x,5)", division))

# ---- group: P1: Seattle // P2: Houston // P3: Chicago
# BEO Problems 1 - 3
list = ValueList({"Chicago": 0, "Houston": 1, "Seattle": 2}, selected="Seattle")

# ----
optimization_solver_with_surrogate_model = MOpossum224(OpossumData_objective=num_2, OpossumData_variable=[number_slider_4, number_slider_2, number_slider_3, number_slider])  # "Optimization Solver with Surrogate Models"

# ---- group: parameters
number_slider = Slider(0.2018, range=0.2..0.8)
number_slider_2 = Slider(5.893, range=0.1..5.9)
number_slider_3 = Slider(3.369, range=0.1..5.9)
number_slider_4 = Slider(13.19, range=-180..180)

# ----
templates_idf = Panel("""simple_chicago_template
simple_houston_template
simple_seattle_template""")
weather_files = Panel("""USA_IL_Chicago-OHare.725300_TMY2
USA_TX_Houston-Intercontinental.722430_TMY2
USA_WA_Seattle-Tacoma.727930_TMY2""")
item = ListItem(List=templates_idf, Index=list, Wrap=False)
item_2 = ListItem(List=weather_files, Index=list, Wrap=False)
panel_2 = Panel("winE")  # disabled
panel_3 = Panel("D:\Vscode\IC\DataGH\25trans")  # disabled
panel_4 = Panel("D:\Vscode\IC\DataGH\25winE")  # disabled
panel_5 = Panel("D:\Vscode\IC\DataGH\25orientation")  # disabled
panel_6 = Panel("orientation")  # disabled
panel_7 = Panel("winW")  # disabled
panel_8 = Panel("D:\Vscode\IC\DataGH\25winW")  # disabled
panel_9 = Panel("transmitance")  # disabled
toggle = BooleanToggle(False)  # disabled
toggle_2 = BooleanToggle(True)  # disabled
toggle_3 = BooleanToggle(False)  # disabled
toggle_4 = BooleanToggle(False)  # disabled
toggle_5 = BooleanToggle(False)  # disabled
toggle_6 = BooleanToggle(True)  # disabled
pythonremote = GHPythonRemote()
panel_10 = Panel("f(x)")  # disabled
panel_11 = Panel("D:\Vscode\IC\DataGH\25fxsim")  # disabled
panel_12 = Panel("D:\Vscode\IC\DataGH\25fxrn")  # disabled
panel_13 = Panel("f(x)")  # disabled
toggle_7 = BooleanToggle(False)  # disabled
toggle_8 = BooleanToggle(False)  # disabled
toggle_9 = BooleanToggle(False)  # disabled

# ---- group: Gravando os parametros gerados pelo Galapagos e o resultado simulado
rec = DataRecorder(flatten(number_slider), DataLimit=-10, RecordData=True)
rec_2 = DataRecorder(flatten(number_slider_2), DataLimit=-10, RecordData=True)
rec_3 = DataRecorder(flatten(number_slider_3), DataLimit=-10, RecordData=True)
rec_4 = DataRecorder(flatten(number_slider_4), DataLimit=-10, RecordData=True)

# ----
excelwrite = ExcelWrite(
    WriteExcelData=toggle_6,
    WorkbookPath=panel_5,
    WorksheetName="resultados",
    ColumnHeadings=panel_6,
    Data=rec_4,
    ClearSheet=toggle_2)  # disabled
excelwrite_2 = ExcelWrite(
    WriteExcelData=toggle_6,
    WorkbookPath=panel_8,
    WorksheetName="resultados",
    ColumnHeadings=panel_7,
    Data=rec_2,
    ClearSheet=toggle_3)  # disabled
excelwrite_3 = ExcelWrite(
    WriteExcelData=toggle_6,
    WorkbookPath=panel_4,
    WorksheetName="resultados",
    ColumnHeadings=panel_2,
    Data=rec_3,
    ClearSheet=toggle)  # disabled
excelwrite_4 = ExcelWrite(
    WriteExcelData=toggle_6,
    WorkbookPath=panel_3,
    WorksheetName="resultados",
    ColumnHeadings=panel_9,
    Data=rec,
    ClearSheet=toggle_5)  # disabled

lng = ListLength(List=rec)
expression = Expression(x=lng, y=int, Expression="If(x > y, true, false)")
expression_2 = Expression(x=lng, y=int, Expression="If(x > y, false, true)")

wettersimplepara = WetterSimplePara(
    Idf=item,
    Weather=item_2,
    Run=expression_2,
    Orientation=number_slider_4,
    WindowLW=number_slider_2,
    WindowLE=number_slider_3,
    Transmittance=number_slider,
    Folder=panel)

# ---- group: Gravando os parametros gerados pelo Galapagos e o resultado simulado (continued)
rec_5 = DataRecorder(flatten(wettersimplepara), DataLimit=-10, RecordData=True)

# ----
salvadados = GhPythonScript(
    ori=number_slider_4,
    win_w=number_slider_2,
    win_e=number_slider_3,
    trans=number_slider,
    fx=wettersimplepara,
    run=expression_2)
# ---------- salvadados: Python ----------
__author__ = "henri"
__version__ = "2023.11.02"

import rhinoscriptsyntax as rs
import scriptcontext as sc
import ghpythonremote
import os
pd = sc.sticky['pandas']
metrics = sc.sticky['sklearn.metrics']
sk = sc.sticky['sklearn']
np = sc.sticky['numpy']
csv_file = 'D:\\Rhino 7\\Projects\\arquivo.csv'

if run:
    if os.path.isfile(csv_file):
        # Se o arquivo existe, leia o conteúdo atual
        df = pd.read_csv(csv_file)
    else:
        # Se o arquivo não existe, crie um DataFrame vazio com as colunas desejadas
        df = pd.DataFrame(columns=['fx', 'orientation', 'win_w', 'win_e', 'trans'])

    # Adicionar os novos valores
    new_data = {'fx': [fx], 'orientation': [ori], 'win_w': [win_w], 'win_e': [win_e], 'trans': [trans]}
    new_df = pd.DataFrame(new_data)

    # Acrescentar os novos valores ao DataFrame existente
    df = df.append(new_df, ignore_index=True)

    # Salvar o DataFrame atualizado no arquivo CSV com formatação correta das colunas 'win_e' e 'win_w'
    df.to_csv(csv_file, index=False)  # Formato de ponto flutuante com 6 casas decimais
# ---------- end salvadados ----------

# ---- group: Apenas a % desejada(A)
split = SplitList(List=rec, Index=int)  # -> ListA, ListB
split_2 = SplitList(List=rec_4, Index=int)  # -> ListA, ListB
split_3 = SplitList(List=rec_2, Index=int)  # -> ListA, ListB
clean = CleanTree(RemoveNulls=True, RemoveInvalid=False, RemoveEmpty=False, Tree=rec_5)
split_4 = SplitList(List=rec_3, Index=int)  # -> ListA, ListB

# ----
machine_learning = GhPythonScript(
    orientation=split_2.ListA,
    win_w=split_3.ListA,
    win_e=split_4.ListA,
    trans=split.ListA,
    fx=clean,
    orientationP=number_slider_4,
    win_wP=number_slider_2,
    win_eP=number_slider_3,
    transP=number_slider,
    fitar=expression)  # -> out, fxP; inputs orientation: list, win_w: list, win_e: list, trans: list, fx: list, orientationP: list, win_wP: list, win_eP: list, transP: list
# ---------- machine_learning: Python ----------
__author__ = "yudur"
__version__ = "2022.03.11"

import rhinoscriptsyntax as rs
import scriptcontext as sc
import ghpythonremote
import os
pd = sc.sticky['pandas']
metrics = sc.sticky['sklearn.metrics']
sk = sc.sticky['sklearn']
np = sc.sticky['numpy']


if(fitar):
    csv_file = 'D:\\Rhino 7\\Projects\\arquivo.csv'
#Fazer os ndarray
#Fazer os dataframes
#    x_train = pd.DataFrame(np.column_stack([orientation, trans, win_e, win_w]), columns = ['orientation', 'trans', 'win_e', 'win_w'])
#    y_train = pd.DataFrame(fx, columns = ['fx'])
#       # Verificar as dimensões e ajustar x_train, se necessário
#    if len(x_train) > len(y_train):
#        x_train = x_train.iloc[:len(y_train)]
#        
#    x_train.to_csv('D:\\Rhino 7\\Projects\\xtrain.csv', index=False)
#    y_train.to_csv('D:\\Rhino 7\\Projects\\ytrain.csv', index=False)
        
    df = pd.read_csv(csv_file, header=None)
    y_train = df.iloc[1:, 0]  # Pega a primeira coluna ('fx') e coloca em y_train
    x_train = df.iloc[1:, 1:]
    
#Separar 80% de treino e 20% teste
#X_train, X_test, y_train, y_test = sk.model_selection.train_test_split(x, test_size = 0.20)
#Escalar os resultados pra evitar discrepâncias
    scaler = sk.preprocessing.StandardScaler()
    scaler.fit(x_train)
    x_train = scaler.transform(x_train)
    mlp = sk.neural_network.MLPRegressor(hidden_layer_sizes=(30, 30, 30), max_iter=4000)
    y_train = y_train.to_numpy()
    y_train.ravel()
    mlp.fit(x_train, y_train)
    x_predizer = pd.DataFrame(np.column_stack([orientationP, transP, win_eP, win_wP]), columns = ['orientationP', 'win_wP', 'win_eP', 'transP'])
    x_predizer = scaler.transform(x_predizer)
    predicao = mlp.predict(x_predizer)
    fxP = float(predicao[0])
# ---------- end machine_learning ----------

escolher_simular_ou_predizer = GhPythonScript(kwh=wettersimplepara, execucoes=expression, fxP=machine_learning.fxP)  # -> out, a
# ---------- escolher_simular_ou_predizer: Python ----------
__author__ = "yudur"
__version__ = "2022.05.06"

import rhinoscriptsyntax as rs
if(execucoes):
    a = fxP
else:
    a = kwh
# ---------- end escolher_simular_ou_predizer ----------
num_2 = Number(escolher_simular_ou_predizer.a)

rec_6 = DataRecorder(machine_learning.fxP, DataLimit=-10, RecordData=True)
clean_2 = CleanTree(RemoveNulls=True, RemoveInvalid=True, RemoveEmpty=False, Tree=rec_6)  # disabled
panel_14 = Panel(machine_learning.out)
panel_15 = Panel(rec_6)
excelwrite_5 = ExcelWrite(
    WriteExcelData=toggle_6,
    WorkbookPath=panel_11,
    WorksheetName="resultados",
    ColumnHeadings=panel_10,
    Data=clean,
    ClearSheet=toggle_8)  # disabled
excelwrite_6 = ExcelWrite(
    WriteExcelData=toggle_6,
    WorkbookPath=panel_12,
    WorksheetName="resultados",
    ColumnHeadings=panel_13,
    Data=clean_2,
    ClearSheet=toggle_9)  # disabled

# ==== cluster GHPythonRemote: Connects the Grasshopper Python component to an external Python instance.
panel = Panel("C:\Users\henri\AppData\Roaming\Grasshopper\UserObjects\gh-python-remote\examples")
# GH to python remote example.
# Pierre Cuvilliers, 2017-2018
# Released under the MIT license
# github.com/pilcru/ghpythonremote
# Runs and connects to an external python engine, and
# assigns imported modules to scriptcontext.sticky variables.
# 
# Arguments:
#       code (str): Path to the GH_to_python_sticky.py code file.
#       location (str): Path to a python executable, or to a folder
#             containing `python.exe`, or the name of a conda-created
#             virtual environment prefixed by `conda://` (`conda://env_name`).
#             If empty, finds python from your windows %PATH%.
#       run (boolean): Creates the connection, and imports new
#             modules, when turned to True. Kills the connection,
#             and deletes the references to the imports, when turned
#             to False.
#       modules (str list): List of module names to import in the
#             remote python. They will be added to the
#             scriptcontext.sticky dictionary, allowing them to be
#             reused from other python components in the same
#             Grasshopper document. Submodules (for example
#             `numpy.linalg` have to be added explicitly to this list
#             to be available later.
#       log_level (str from ['NOTSET', 'DEBUG', 'INFO', 'WARNING', 'ERROR', 'CRITICAL']):
#             Logging level to use for the local IronPython and the
#             remote python instance.
#       working_dir (str): Working directory for the remote python
#             instance.
# 
# Returns:
#       out (str): Console output with DEBUG information.
#       linked_modules (str list): list of imported module names.
#       rpy (rpyc connection object): The object representing the
#             remote Python interpreter.
panel_2 = Panel("E:\Anaconda\envs\rhinoremote")
panel_3 = Panel("""numpy
sklearn
sklearn.metrics
pandas""")
list = ValueList({"CRITICAL", "ERROR", "WARNING", "INFO", "DEBUG", "NOTSET"}, selected="DEBUG")
ghpythonremote = GHPythonRemote(location=panel_2, run=Toggle(True), modules=panel_3, log_level=list, working_dir=panel)  # -> out, linked_modules, rpy; inputs run: Boolean, modules: list
# ---------- ghpythonremote: Python ----------
import inspect
import logging
from os import path
import sys
from time import sleep

import scriptcontext

import ghpythonremote
from ghpythonremote.connectors import GrasshopperToPythonRemote

local_log_level = getattr(logging, log_level, logging.WARNING)
logger = logging.getLogger("ghpythonremote")
logger.setLevel(local_log_level)
ch = logging.StreamHandler()
ch.setLevel(local_log_level)
formatter = logging.Formatter("%(levelname)s: %(name)s:\n%(message)s")
ch.setFormatter(formatter)
logger.handlers = []
logger.addHandler(ch)
logger = logging.getLogger("ghpythonremote.GH_to_python")

ROOT = path.abspath(path.dirname(inspect.getfile(ghpythonremote)))
rpyc_server_py = path.join(ROOT, "pythonservice.py")

# Set connection to CLOSED if this is the first run
# and initialize set of linked modules
try:
    remote_python_status
except NameError:
    remote_python_status = "CLOSED"
    lkd_modules = set()

# Wait for connection to connect or terminate
timer = 0
while remote_python_status == "CONNECTING" or remote_python_status == "CLOSING":
    sleep(1)
    timer += 1
    if timer == 10:
        try:
            gh2py_manager.__exit__(*sys.exc_info())
        except Exception:
            pass
        remote_python_status = "CLOSED"
        lkd_modules = set()
        raise RuntimeError(
            "Connection left in an inconsistent state and not returning. Reset "
            "everything."
        )

if run:
    if not remote_python_status == "OPEN":
        remote_python_status = "CONNECTING"
        gh2py_manager = GrasshopperToPythonRemote(
            rpyc_server_py,
            location=location,
            timeout=10,
            port=None,
            log_level=log_level,
            working_dir=working_dir,
        )
        gh2py = gh2py_manager.__enter__()
        remote_python_status = "OPEN"

    # Stuff that we can reach
    rpymod = gh2py.py_remote_modules  # A getter function for a named python module
    rpy = gh2py.connection  # Represents the remote instance root object
    scriptcontext.sticky["rpy"] = rpy
    # Add modules
    for mod in modules:
        try:
            scriptcontext.sticky[mod] = rpymod(mod)
            lkd_modules.add(mod)
        except ImportError:
            gh2py_manager.__exit__(*sys.exc_info())
            raise

elif not remote_python_status == "CLOSED":
    remote_python_status = "CLOSING"
    # Remove linked modules
    for mod in lkd_modules:
        del scriptcontext.sticky[mod]
    del scriptcontext.sticky["rpy"]
    gh2py_manager.__exit__(*sys.exc_info())
    lkd_modules = set()
    remote_python_status = "CLOSED"

# Change variable name because ghpython resets outputs to None before each run
linked_modules = lkd_modules

logger.info("GH to python connection is {}".format(remote_python_status))
# ---------- end ghpythonremote ----------
panel_4 = Panel(ghpythonremote.out)
