# Grasshopper definition Rede Neural Reutilizavel.gh (Grasshopper 1.0.7)
# Copyright: © 2017-2018 Pierre Cuvilliers, Caitlin Mueller, Massachusetts Institute of Technology
# plug-ins: GHEnergyPlus, Opossum2_0_Proto_A

# ---- group: Choose Input folder index
panel = Panel("0")

# ---- group: Aqui calcula a porcentagem
porcentagem = B(14)
num = Number(700)
multiplication = Multiplication(A=num, B=porcentagem)
division = Division(A=multiplication, B=100)
int = Integer(expr("Round(x,5)", division))

# ---- group: P1: Seattle // P2: Houston // P3: Chicago
# BEO Problems 1 - 3
list = ValueList({"Chicago": 0, "Houston": 1, "Seattle": 2}, selected="Seattle")

# ----
optimization_solver_with_surrogate_model = MOpossum224(OpossumData_objective=num_2, OpossumData_variable=[number_slider_4, number_slider_2, number_slider_3, number_slider])  # "Optimization Solver with Surrogate Models"

# ---- group: parameters
number_slider = Slider(0.3834, range=0.2..0.8)
number_slider_2 = Slider(5.777, range=0.1..5.9)
number_slider_3 = Slider(5.57, range=0.1..5.9)
number_slider_4 = Slider(74.85, range=-180..180)

# ----
templates_idf = Panel("""simple_chicago_template
simple_houston_template
simple_seattle_template""")
weather_files = Panel("""USA_IL_Chicago-OHare.725300_TMY2
USA_TX_Houston-Intercontinental.722430_TMY2
USA_WA_Seattle-Tacoma.727930_TMY2""")
item = ListItem(List=templates_idf, Index=list, Wrap=False)
item_2 = ListItem(List=weather_files, Index=list, Wrap=False)

# ---- group: Gravando os parametros gerados pelo Galapagos e o resultado simulado
rec = DataRecorder(flatten(number_slider), DataLimit=-10, RecordData=True)

# ----
pythonremote = GHPythonRemote()

lng = ListLength(List=rec)
decider = GhPythonScript(x=lng, y=int)  # -> a, foutIA
# ---------- decider: Python ----------
__author__ = "henri"
__version__ = "2023.11.02"

import rhinoscriptsyntax as rs
import random

chanceSimular = 0.53

if x>y:
    outSimu = False
    outIA = True
else:
    outSimu = True
    outIA = False
    
if chanceSimular>random.random():
    outSimu = True
    outIA = False
    
    
a = outSimu
foutIA = outIA
# ---------- end decider ----------

wettersimplepara = WetterSimplePara(
    Idf=item,
    Weather=item_2,
    Run=decider.a,
    Orientation=number_slider_4,
    WindowLW=number_slider_2,
    WindowLE=number_slider_3,
    Transmittance=number_slider,
    Folder=panel)
machine_learning = GhPythonScript(orientationP=number_slider_4, win_wP=number_slider_2, win_eP=number_slider_3, transP=number_slider, fitar=decider.foutIA)  # -> out, fxP; inputs orientationP: list, win_wP: list, win_eP: list, transP: list
# ---------- machine_learning: Python ----------
__author__ = "yudur"
__version__ = "2022.03.11"

import rhinoscriptsyntax as rs
import scriptcontext as sc
import ghpythonremote
import os
pd = sc.sticky['pandas']
metrics = sc.sticky['sklearn.metrics']
sk = sc.sticky['sklearn']
np = sc.sticky['numpy']


if(fitar):
    #csv_file = 'C:\Users\henri\AppData\Roaming\Grasshopper\UserObjects\data.csv'
    csv_file = 'E:\Vscode\IC\DataGH\SimPredictions\data22.csv'
#Fazer os ndarray
#Fazer os dataframes
#    x_train = pd.DataFrame(np.column_stack([orientation, trans, win_e, win_w]), columns = ['orientation', 'trans', 'win_e', 'win_w'])
#    y_train = pd.DataFrame(fx, columns = ['fx'])
#       # Verificar as dimensões e ajustar x_train, se necessário
#    if len(x_train) > len(y_train):
#        x_train = x_train.iloc[:len(y_train)]
#        
#    x_train.to_csv('D:\\Rhino 7\\Projects\\xtrain.csv', index=False)
#    y_train.to_csv('D:\\Rhino 7\\Projects\\ytrain.csv', index=False)
        
    df = pd.read_csv(csv_file, header=None)
    y_train = df.iloc[1:, 0]  # Pega a primeira coluna ('fx') e coloca em y_train
    x_train = df.iloc[1:, 1:]
    
#Separar 80% de treino e 20% teste
#X_train, X_test, y_train, y_test = sk.model_selection.train_test_split(x, test_size = 0.20)
#Escalar os resultados pra evitar discrepâncias
    scaler = sk.preprocessing.StandardScaler()
    scaler.fit(x_train)
    x_train = scaler.transform(x_train)
    mlp = sk.neural_network.MLPRegressor(hidden_layer_sizes=(30, 30, 30), max_iter=4000)
    y_train = y_train.to_numpy()
    y_train.ravel()
    mlp.fit(x_train, y_train)
    x_predizer = pd.DataFrame(np.column_stack([orientationP, transP, win_eP, win_wP]), columns = ['orientationP', 'win_wP', 'win_eP', 'transP'])
    x_predizer = scaler.transform(x_predizer)
    predicao = mlp.predict(x_predizer)
    fxP = float(predicao[0])
    
    #Guarda dados em um arquivo
    data_path = 'E:\Vscode\IC\DataGH\IAPredictions\IA_data_all.csv'
    if os.path.isfile(data_path):
        # Se o arquivo existe, leia o conteúdo atual
        df = pd.read_csv(data_path)
    else:
        # Se o arquivo não existe, crie um DataFrame vazio com as colunas desejadas
        df = pd.DataFrame(columns=['fx', 'orientation', 'win_w', 'win_e', 'trans'])

    # Adicionar os novos valores
    new_data = {'fx': [fxP], 'orientation': [orientationP[0]], 'win_w': [win_wP[0]], 'win_e': [win_eP[0]], 'trans': [transP[0]]}
    new_df = pd.DataFrame(new_data)

    # Acrescentar os novos valores ao DataFrame existente
    df = df.append(new_df, ignore_index=True)

    # Salvar o DataFrame atualizado no arquivo CSV com formatação correta das colunas 'win_e' e 'win_w'
    df.to_csv(data_path, index=False)
# ---------- end machine_learning ----------

escolher_simular_ou_predizer = GhPythonScript(kwh=wettersimplepara, execucoes=decider.foutIA, fxP=machine_learning.fxP)  # -> out, a
# ---------- escolher_simular_ou_predizer: Python ----------
__author__ = "yudur"
__version__ = "2022.05.06"

import rhinoscriptsyntax as rs
if(execucoes):
    a = fxP
else:
    a = kwh
# ---------- end escolher_simular_ou_predizer ----------
num_2 = Number(escolher_simular_ou_predizer.a)

salvadados = GhPythonScript(
    ori=number_slider_4,
    win_w=number_slider_2,
    win_e=number_slider_3,
    trans=number_slider,
    fx=wettersimplepara,
    run=decider.a)
# ---------- salvadados: Python ----------
__author__ = "henri"
__version__ = "2023.11.02"

import rhinoscriptsyntax as rs
import scriptcontext as sc
import ghpythonremote
import os
pd = sc.sticky['pandas']
metrics = sc.sticky['sklearn.metrics']
sk = sc.sticky['sklearn']
np = sc.sticky['numpy']
#csv_file = 'C:\Users\henri\AppData\Roaming\Grasshopper\UserObjects\data.csv'
csv_file = 'E:\Vscode\IC\DataGH\SimPredictions\data22.csv'

if run:
    if os.path.isfile(csv_file):
        # Se o arquivo existe, leia o conteúdo atual
        df = pd.read_csv(csv_file)
    else:
        # Se o arquivo não existe, crie um DataFrame vazio com as colunas desejadas
        df = pd.DataFrame(columns=['fx', 'orientation', 'win_w', 'win_e', 'trans'])

    # Adicionar os novos valores
    new_data = {'fx': [fx], 'orientation': [ori], 'win_w': [win_w], 'win_e': [win_e], 'trans': [trans]}
    new_df = pd.DataFrame(new_data)

    # Acrescentar os novos valores ao DataFrame existente
    df = df.append(new_df, ignore_index=True)

    # Salvar o DataFrame atualizado no arquivo CSV com formatação correta das colunas 'win_e' e 'win_w'
    df.to_csv(csv_file, index=False)
# ---------- end salvadados ----------
rec_2 = DataRecorder(machine_learning.fxP, DataLimit=-10, RecordData=True)
panel_2 = Panel(machine_learning.out)
panel_3 = Panel(rec_2)

# ==== cluster GHPythonRemote: Connects the Grasshopper Python component to an external Python instance.
panel = Panel("C:\Users\henri\AppData\Roaming\Grasshopper\UserObjects\gh-python-remote\examples")
# GH to python remote example.
# Pierre Cuvilliers, 2017-2018
# Released under the MIT license
# github.com/pilcru/ghpythonremote
# Runs and connects to an external python engine, and
# assigns imported modules to scriptcontext.sticky variables.
# 
# Arguments:
#       code (str): Path to the GH_to_python_sticky.py code file.
#       location (str): Path to a python executable, or to a folder
#             containing `python.exe`, or the name of a conda-created
#             virtual environment prefixed by `conda://` (`conda://env_name`).
#             If empty, finds python from your windows %PATH%.
#       run (boolean): Creates the connection, and imports new
#             modules, when turned to True. Kills the connection,
#             and deletes the references to the imports, when turned
#             to False.
#       modules (str list): List of module names to import in the
#             remote python. They will be added to the
#             scriptcontext.sticky dictionary, allowing them to be
#             reused from other python components in the same
#             Grasshopper document. Submodules (for example
#             `numpy.linalg` have to be added explicitly to this list
#             to be available later.
#       log_level (str from ['NOTSET', 'DEBUG', 'INFO', 'WARNING', 'ERROR', 'CRITICAL']):
#             Logging level to use for the local IronPython and the
#             remote python instance.
#       working_dir (str): Working directory for the remote python
#             instance.
# 
# Returns:
#       out (str): Console output with DEBUG information.
#       linked_modules (str list): list of imported module names.
#       rpy (rpyc connection object): The object representing the
#             remote Python interpreter.
panel_2 = Panel("C:\ProgramData\Anaconda3\envs\rhinoremote")
panel_3 = Panel("""numpy
sklearn
sklearn.metrics
pandas""")
list = ValueList({"CRITICAL", "ERROR", "WARNING", "INFO", "DEBUG", "NOTSET"}, selected="DEBUG")
ghpythonremote = GHPythonRemote(location=panel_2, run=Toggle(True), modules=panel_3, log_level=list, working_dir=panel)  # -> out, linked_modules, rpy; inputs run: Boolean, modules: list
# ---------- ghpythonremote: Python ----------
import inspect
import logging
from os import path
import sys
from time import sleep

import scriptcontext

import ghpythonremote
from ghpythonremote.connectors import GrasshopperToPythonRemote

local_log_level = getattr(logging, log_level, logging.WARNING)
logger = logging.getLogger("ghpythonremote")
logger.setLevel(local_log_level)
ch = logging.StreamHandler()
ch.setLevel(local_log_level)
formatter = logging.Formatter("%(levelname)s: %(name)s:\n%(message)s")
ch.setFormatter(formatter)
logger.handlers = []
logger.addHandler(ch)
logger = logging.getLogger("ghpythonremote.GH_to_python")

ROOT = path.abspath(path.dirname(inspect.getfile(ghpythonremote)))
rpyc_server_py = path.join(ROOT, "pythonservice.py")

# Set connection to CLOSED if this is the first run
# and initialize set of linked modules
try:
    remote_python_status
except NameError:
    remote_python_status = "CLOSED"
    lkd_modules = set()

# Wait for connection to connect or terminate
timer = 0
while remote_python_status == "CONNECTING" or remote_python_status == "CLOSING":
    sleep(1)
    timer += 1
    if timer == 10:
        try:
            gh2py_manager.__exit__(*sys.exc_info())
        except Exception:
            pass
        remote_python_status = "CLOSED"
        lkd_modules = set()
        raise RuntimeError(
            "Connection left in an inconsistent state and not returning. Reset "
            "everything."
        )

if run:
    if not remote_python_status == "OPEN":
        remote_python_status = "CONNECTING"
        gh2py_manager = GrasshopperToPythonRemote(
            rpyc_server_py,
            location=location,
            timeout=10,
            port=None,
            log_level=log_level,
            working_dir=working_dir,
        )
        gh2py = gh2py_manager.__enter__()
        remote_python_status = "OPEN"

    # Stuff that we can reach
    rpymod = gh2py.py_remote_modules  # A getter function for a named python module
    rpy = gh2py.connection  # Represents the remote instance root object
    scriptcontext.sticky["rpy"] = rpy
    # Add modules
    for mod in modules:
        try:
            scriptcontext.sticky[mod] = rpymod(mod)
            lkd_modules.add(mod)
        except ImportError:
            gh2py_manager.__exit__(*sys.exc_info())
            raise

elif not remote_python_status == "CLOSED":
    remote_python_status = "CLOSING"
    # Remove linked modules
    for mod in lkd_modules:
        del scriptcontext.sticky[mod]
    del scriptcontext.sticky["rpy"]
    gh2py_manager.__exit__(*sys.exc_info())
    lkd_modules = set()
    remote_python_status = "CLOSED"

# Change variable name because ghpython resets outputs to None before each run
linked_modules = lkd_modules

logger.info("GH to python connection is {}".format(remote_python_status))
# ---------- end ghpythonremote ----------
panel_4 = Panel(ghpythonremote.out)
