# Grasshopper definition Rede Neural.gh (Grasshopper 1.0.7)
# Copyright: © 2017-2018 Pierre Cuvilliers, Caitlin Mueller, Massachusetts Institute of Technology
# plug-ins: GHEnergyPlus, LunchBox, Opossum2_0_Proto_A

# ---- group: Choose Input folder index
panel = Panel("0")

# ----
num = Number(700)

# ---- group: Aqui calcula a porcentagem
porcentagem = B(60)
multiplication = Multiplication(A=num, B=porcentagem)
division = Division(A=multiplication, B=100)
int = Integer(expr("Round(x,5)", division))

# ---- group: P1: Seattle // P2: Houston // P3: Chicago
# BEO Problems 1 - 3
list = ValueList({"Chicago": 0, "Houston": 1, "Seattle": 2}, selected="Seattle")

# ----
optimization_solver_with_surrogate_model = MOpossum224(
    OpossumData_NumberOfObjectives=1,
    OpossumData_OptimizationType=0,
    OpossumData_ResultSerializationStatus=1,
    OpossumData_ObjectiveValue=[216.8963435, 141.826627, 153.1810817, 171.7097493, 168.4319987, 234.9895336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],
    OpossumData_ParameterList=["-163.325444,1.675969,0.235552,0.286834", "38.797071,4.916547,5.864234,0.748354", "0.000000,3.000000,3.000000,0.500000", "175.026534,0.165970,5.867184,0.213115", "173.282494,5.850031,0.101395,0.794055", "174.980491,0.127162,0.211690,0.799679"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],
    OpossumData_objective=num_2,
    OpossumData_variable=[number_slider, number_slider_2, number_slider_3, number_slider_4])  # "Optimization Solver with Surrogate Models"

# ---- group: parameters
number_slider = Slider(116.21, range=-180..180)
number_slider_2 = Slider(5.882, range=0.1..5.9)
number_slider_3 = Slider(5.307, range=0.1..5.9)
number_slider_4 = Slider(0.3218, range=0.2..0.8)

# ----
templates_idf = Panel("""simple_chicago_template
simple_houston_template
simple_seattle_template""")
weather_files = Panel("""USA_IL_Chicago-OHare.725300_TMY2
USA_TX_Houston-Intercontinental.722430_TMY2
USA_WA_Seattle-Tacoma.727930_TMY2""")
item = ListItem(List=templates_idf, Index=list, Wrap=False)
item_2 = ListItem(List=weather_files, Index=list, Wrap=False)
panel_2 = Panel("winE")  # disabled
panel_3 = Panel("C:\Users\yudur\Desktop\IC\6040\25trans")  # disabled
panel_4 = Panel("C:\Users\yudur\Desktop\IC\6040\25winE")  # disabled
panel_5 = Panel("orientation")  # disabled
panel_6 = Panel("winW")  # disabled
panel_7 = Panel("C:\Users\yudur\Desktop\IC\6040\25Orientation")  # disabled
panel_8 = Panel("C:\Users\yudur\Desktop\IC\6040\25winW")  # disabled
panel_9 = Panel("transmitance")  # disabled
toggle = BooleanToggle(False)  # disabled
toggle_2 = BooleanToggle(False)  # disabled
toggle_3 = BooleanToggle(False)  # disabled
toggle_4 = BooleanToggle(False)  # disabled
toggle_5 = BooleanToggle(False)  # disabled
toggle_6 = BooleanToggle(False)  # disabled
toggle_7 = BooleanToggle(False)  # disabled
toggle_8 = BooleanToggle(False)  # disabled
pythonremote = GHPythonRemote()
panel_10 = Panel("f(x)")  # disabled
panel_11 = Panel("C:\Users\yudur\Desktop\IC\6040\25fxsim")  # disabled
panel_12 = Panel("C:\Users\yudur\Desktop\IC\6040\25fxrn")  # disabled
panel_13 = Panel("f(x)")  # disabled
toggle_9 = BooleanToggle(False)  # disabled
toggle_10 = BooleanToggle(False)  # disabled
toggle_11 = BooleanToggle(False)  # disabled

# ---- group: Gravando os parametros gerados pelo Galapagos e o resultado simulado
rec = DataRecorder(flatten(number_slider), DataLimit=-10, RecordData=True)
rec_2 = DataRecorder(flatten(number_slider_2), DataLimit=-10, RecordData=True)
rec_3 = DataRecorder(flatten(number_slider_3), DataLimit=-10, RecordData=True)
rec_4 = DataRecorder(flatten(number_slider_4), DataLimit=-10, RecordData=True)

# ----
excelwrite = ExcelWrite(
    WriteExcelData=toggle_8,
    WorkbookPath=panel_7,
    WorksheetName="resultados",
    ColumnHeadings=panel_5,
    Data=rec,
    ClearSheet=toggle_4)  # disabled
excelwrite_2 = ExcelWrite(
    WriteExcelData=toggle_8,
    WorkbookPath=panel_4,
    WorksheetName="resultados",
    ColumnHeadings=panel_2,
    Data=rec_3,
    ClearSheet=toggle_3)  # disabled
excelwrite_3 = ExcelWrite(
    WriteExcelData=toggle_8,
    WorkbookPath=panel_8,
    WorksheetName="resultados",
    ColumnHeadings=panel_6,
    Data=rec_2,
    ClearSheet=toggle_5)  # disabled
excelwrite_4 = ExcelWrite(
    WriteExcelData=toggle_8,
    WorkbookPath=panel_3,
    WorksheetName="resultados",
    ColumnHeadings=panel_9,
    Data=rec_4,
    ClearSheet=toggle_7)  # disabled

lng = ListLength(List=rec_4)
expression = Expression(x=lng, y=int, Expression="If(x > y, true, false)")
expression_2 = Expression(x=lng, y=int, Expression="If(x > y, false, true)")

wettersimplepara = WetterSimplePara(
    Idf=item,
    Weather=item_2,
    Run=expression_2,
    Orientation=number_slider,
    WindowLW=number_slider_2,
    WindowLE=number_slider_3,
    Transmittance=number_slider_4,
    Folder=panel)

# ---- group: Gravando os parametros gerados pelo Galapagos e o resultado simulado (continued)
rec_5 = DataRecorder(flatten(wettersimplepara), DataLimit=-10, RecordData=True)

# ---- group: Apenas a % desejada(A)
split = SplitList(List=rec, Index=int)  # -> ListA, ListB
split_2 = SplitList(List=rec_2, Index=int)  # -> ListA, ListB
split_3 = SplitList(List=rec_3, Index=int)  # -> ListA, ListB
split_4 = SplitList(List=rec_4, Index=int)  # -> ListA, ListB
clean = CleanTree(RemoveNulls=True, RemoveInvalid=False, RemoveEmpty=False, Tree=rec_5)

# ----
machine_learning = GhPythonScript(
    orientation=split.ListA,
    win_w=split_2.ListA,
    win_e=split_3.ListA,
    trans=split_4.ListA,
    fx=clean,
    orientationP=number_slider,
    win_wP=number_slider_2,
    win_eP=number_slider_3,
    transP=number_slider_4,
    fitar=expression)  # -> out, fxP; inputs orientation: list, win_w: list, win_e: list, trans: list, fx: list, orientationP: list, win_wP: list, win_eP: list, transP: list
# ---------- machine_learning: Python ----------
__author__ = "yudur"
__version__ = "2022.03.11"

import rhinoscriptsyntax as rs
import scriptcontext as sc
import ghpythonremote
pd = sc.sticky['pandas']
metrics = sc.sticky['sklearn.metrics']
sk = sc.sticky['sklearn']
np = sc.sticky['numpy']

if(fitar):

#Fazer os ndarray
#Fazer os dataframes
    x_train = pd.DataFrame(np.column_stack([orientation, win_w, win_e, trans]), columns = ['orientation', 'win_w', 'win_e', 'trans'])
    y_train = pd.DataFrame(fx, columns = ['fx'])
#Separar 80% de treino e 20% teste
#X_train, X_test, y_train, y_test = sk.model_selection.train_test_split(x, test_size = 0.20)
#Escalar os resultados pra evitar discrepâncias
    scaler = sk.preprocessing.StandardScaler()
    scaler.fit(x_train)
    x_train = scaler.transform(x_train)
    mlp = sk.neural_network.MLPRegressor(hidden_layer_sizes=(30, 30, 30), max_iter=4000)
    y_train = y_train.to_numpy()
    y_train.ravel()
    mlp.fit(x_train, y_train)
    x_predizer = pd.DataFrame(np.column_stack([orientationP, win_wP, win_eP, transP]), columns = ['orientationP', 'win_wP', 'win_eP', 'transP'])
    x_predizer = scaler.transform(x_predizer)
    predicao = mlp.predict(x_predizer)
    fxP = float(predicao[0])
# ---------- end machine_learning ----------

escolher_simular_ou_predizer = GhPythonScript(kwh=wettersimplepara, execucoes=expression, fxP=machine_learning.fxP)  # -> out, a
# ---------- escolher_simular_ou_predizer: Python ----------
__author__ = "yudur"
__version__ = "2022.05.06"

import rhinoscriptsyntax as rs
if(execucoes):
    a = fxP
else:
    a = kwh
# ---------- end escolher_simular_ou_predizer ----------
num_2 = Number(escolher_simular_ou_predizer.a)

rec_6 = DataRecorder(machine_learning.fxP, DataLimit=-10, RecordData=True)
clean_2 = CleanTree(RemoveNulls=True, RemoveInvalid=True, RemoveEmpty=False, Tree=rec_6)  # disabled
panel_14 = Panel(machine_learning.out)
excelwrite_5 = ExcelWrite(
    WriteExcelData=toggle_8,
    WorkbookPath=panel_11,
    WorksheetName="resultados",
    ColumnHeadings=panel_10,
    Data=clean,
    ClearSheet=toggle_10)  # disabled
excelwrite_6 = ExcelWrite(
    WriteExcelData=toggle_8,
    WorkbookPath=panel_12,
    WorksheetName="resultados",
    ColumnHeadings=panel_13,
    Data=clean_2,
    ClearSheet=toggle_11)  # disabled

# ==== cluster GHPythonRemote: Connects the Grasshopper Python component to an external Python instance.
panel = Panel("C:\Users\yudur\AppData\Roaming\Grasshopper\UserObjects\gh-python-remote\examples")
# GH to python remote example.
# Pierre Cuvilliers, 2017-2018
# Released under the MIT license
# github.com/pilcru/ghpythonremote
# Runs and connects to an external python engine, and
# assigns imported modules to scriptcontext.sticky variables.
# 
# Arguments:
#       code (str): Path to the GH_to_python_sticky.py code file.
#       location (str): Path to a python executable, or to a folder
#             containing `python.exe`, or the name of a conda-created
#             virtual environment prefixed by `conda://` (`conda://env_name`).
#             If empty, finds python from your windows %PATH%.
#       run (boolean): Creates the connection, and imports new
#             modules, when turned to True. Kills the connection,
#             and deletes the references to the imports, when turned
#             to False.
#       modules (str list): List of module names to import in the
#             remote python. They will be added to the
#             scriptcontext.sticky dictionary, allowing them to be
#             reused from other python components in the same
#             Grasshopper document. Submodules (for example
#             `numpy.linalg` have to be added explicitly to this list
#             to be available later.
#       log_level (str from ['NOTSET', 'DEBUG', 'INFO', 'WARNING', 'ERROR', 'CRITICAL']):
#             Logging level to use for the local IronPython and the
#             remote python instance.
#       working_dir (str): Working directory for the remote python
#             instance.
# 
# Returns:
#       out (str): Console output with DEBUG information.
#       linked_modules (str list): list of imported module names.
#       rpy (rpyc connection object): The object representing the
#             remote Python interpreter.
panel_2 = Panel("C:\Users\yudur\anaconda3\envs\rhinoremote")
panel_3 = Panel("""numpy
sklearn
sklearn.metrics
pandas""")
list = ValueList({"CRITICAL", "ERROR", "WARNING", "INFO", "DEBUG", "NOTSET"}, selected="DEBUG")
ghpythonremote = GHPythonRemote(location=panel_2, run=Toggle(True), modules=panel_3, log_level=list, working_dir=panel)  # -> out, linked_modules, rpy; inputs run: Boolean, modules: list
# ---------- ghpythonremote: Python ----------
import inspect
import logging
from os import path
import sys
from time import sleep

import scriptcontext

import ghpythonremote
from ghpythonremote.connectors import GrasshopperToPythonRemote

local_log_level = getattr(logging, log_level, logging.WARNING)
logger = logging.getLogger("ghpythonremote")
logger.setLevel(local_log_level)
ch = logging.StreamHandler()
ch.setLevel(local_log_level)
formatter = logging.Formatter("%(levelname)s: %(name)s:\n%(message)s")
ch.setFormatter(formatter)
logger.handlers = []
logger.addHandler(ch)
logger = logging.getLogger("ghpythonremote.GH_to_python")

ROOT = path.abspath(path.dirname(inspect.getfile(ghpythonremote)))
rpyc_server_py = path.join(ROOT, "pythonservice.py")

# Set connection to CLOSED if this is the first run
# and initialize set of linked modules
try:
    remote_python_status
except NameError:
    remote_python_status = "CLOSED"
    lkd_modules = set()

# Wait for connection to connect or terminate
timer = 0
while remote_python_status == "CONNECTING" or remote_python_status == "CLOSING":
    sleep(1)
    timer += 1
    if timer == 10:
        try:
            gh2py_manager.__exit__(*sys.exc_info())
        except Exception:
            pass
        remote_python_status = "CLOSED"
        lkd_modules = set()
        raise RuntimeError(
            "Connection left in an inconsistent state and not returning. Reset "
            "everything."
        )

if run:
    if not remote_python_status == "OPEN":
        remote_python_status = "CONNECTING"
        gh2py_manager = GrasshopperToPythonRemote(
            rpyc_server_py,
            location=location,
            timeout=10,
            port=None,
            log_level=log_level,
            working_dir=working_dir,
        )
        gh2py = gh2py_manager.__enter__()
        remote_python_status = "OPEN"

    # Stuff that we can reach
    rpymod = gh2py.py_remote_modules  # A getter function for a named python module
    rpy = gh2py.connection  # Represents the remote instance root object
    scriptcontext.sticky["rpy"] = rpy
    # Add modules
    for mod in modules:
        try:
            scriptcontext.sticky[mod] = rpymod(mod)
            lkd_modules.add(mod)
        except ImportError:
            gh2py_manager.__exit__(*sys.exc_info())
            raise

elif not remote_python_status == "CLOSED":
    remote_python_status = "CLOSING"
    # Remove linked modules
    for mod in lkd_modules:
        del scriptcontext.sticky[mod]
    del scriptcontext.sticky["rpy"]
    gh2py_manager.__exit__(*sys.exc_info())
    lkd_modules = set()
    remote_python_status = "CLOSED"

# Change variable name because ghpython resets outputs to None before each run
linked_modules = lkd_modules

logger.info("GH to python connection is {}".format(remote_python_status))
# ---------- end ghpythonremote ----------
panel_4 = Panel(ghpythonremote.out)
