# Grasshopper definition testesIndividuais.gh (Grasshopper 1.0.7)
# Copyright: © 2017-2018 Pierre Cuvilliers, Caitlin Mueller, Massachusetts Institute of Technology
# plug-ins: GHEnergyPlus

# ---- group: Choose Input folder index
panel = Panel("0")

# ---- group: Aqui calcula a porcentagem
porcentagem = B(28)
num = Number(700)
multiplication = Multiplication(A=num, B=porcentagem)
division = Division(A=multiplication, B=100)
int = Integer(expr("Round(x,5)", division))

# ---- group: P1: Seattle // P2: Houston // P3: Chicago
# BEO Problems 1 - 3
list = ValueList({"Chicago": 0, "Houston": 1, "Seattle": 2}, selected="Seattle")

# ----
templates_idf = Panel("""simple_chicago_template
simple_houston_template
simple_seattle_template""")
weather_files = Panel("""USA_IL_Chicago-OHare.725300_TMY2
USA_TX_Houston-Intercontinental.722430_TMY2
USA_WA_Seattle-Tacoma.727930_TMY2""")
item = ListItem(List=templates_idf, Index=list, Wrap=False)
item_2 = ListItem(List=weather_files, Index=list, Wrap=False)
python = GhPythonScript()  # -> fxIA, ori, winw, wine, trans
# ---------- python: Python ----------
__author__ = "henri"
__version__ = "2023.11.26"


import rhinoscriptsyntax as rs
import scriptcontext as sc
import ghpythonremote
import os
pd = sc.sticky['pandas']
metrics = sc.sticky['sklearn.metrics']
sk = sc.sticky['sklearn']
np = sc.sticky['numpy']


csv_file = 'E:\\Vscode\\IC\\DataGH\\IAPredictions\\testedata.csv'


df = pd.read_csv(csv_file)

if len(df) >= 2:
    # Get the values from the second row
    fxIA = float(df.iloc[1]['fx'])
    ori = float(df.iloc[1]['orientation'])
    trans = float(df.iloc[1]['trans'])
    wine = float(df.iloc[1]['win_e'])
    winw = float(df.iloc[1]['win_w'])

    # Drop the second row from the DataFrame
    df = df.drop(1)

    # Save the modified DataFrame back to the CSV file
    df.to_csv(csv_file, index=False)

    # Now you can use the variables fx, ori, trans, win_e, and win_w as needed
    print('fxIA: {}, ori: {}, trans: {}, wine: {}, winw: {}'.format(fxIA, ori, trans, wine, winw))
else:
    print('Not enough rows in the DataFrame.')
# ---------- end python ----------
wettersimplepara = WetterSimplePara(
    Idf=item,
    Weather=item_2,
    Run=Toggle(True),
    Orientation=python.ori,
    WindowLW=python.winw,
    WindowLE=python.wine,
    Transmittance=python.trans,
    Folder=panel)

lng = ListLength()
decider = GhPythonScript(x=lng, y=int)  # -> a, foutIA
# ---------- decider: Python ----------
__author__ = "henri"
__version__ = "2023.11.02"

import rhinoscriptsyntax as rs
import random

chanceSimular = 0.44

if x>y:
    outSimu = False
    outIA = True
else:
    outSimu = True
    outIA = False
    
if chanceSimular>random.random():
    outSimu = True
    outIA = False
    
    
a = outSimu
foutIA = outIA
# ---------- end decider ----------
escolher_simular_ou_predizer = GhPythonScript(kwh=wettersimplepara, execucoes=decider.foutIA)  # -> out, a
# ---------- escolher_simular_ou_predizer: Python ----------
__author__ = "yudur"
__version__ = "2022.05.06"

import rhinoscriptsyntax as rs
if(execucoes):
    a = fxP
else:
    a = kwh
# ---------- end escolher_simular_ou_predizer ----------
num_2 = Number(escolher_simular_ou_predizer.a)

python_2 = GhPythonScript(fx=wettersimplepara, fxIA=python.fxIA, ori=python.ori, winw=python.winw, wine=python.wine, trans=python.trans)  # -> out, a
# ---------- python_2: Python ----------
__author__ = "henri"
__version__ = "2023.11.26"

import rhinoscriptsyntax as rs
import scriptcontext as sc
import os



pd = sc.sticky['pandas']



data = {'fxIA': [fxIA], 'fx': [fx], 'ori': [ori], 'winw': [winw], 'wine': [wine], 'trans': [trans]}
df = pd.DataFrame(data)

csv_file = 'E:\\Vscode\\IC\\DataGH\\IAPredictions\\output.csv'

# Check if the CSV file exists
if os.path.exists(csv_file):
    # If it exists, load the existing DataFrame from the CSV file
    existing_df = pd.read_csv(csv_file)
    # Append the new data to the existing DataFrame
    df = pd.concat([existing_df, pd.DataFrame({'fxIA': [fxIA], 'fx': [fx], 'ori': [ori], 'winw': [winw], 'wine': [wine], 'trans': [trans]})], ignore_index=True)
else:
    # If it doesn't exist, create a new DataFrame with the input data
    df = pd.DataFrame({'fxIA': [fxIA], 'fx': [fx], 'ori': [ori], 'winw': [winw], 'wine': [wine], 'trans': [trans]})

# Save the DataFrame to the CSV file
df.to_csv(csv_file, index=False)
# ---------- end python_2 ----------
rec = DataRecorder(wettersimplepara, DataLimit=-10, RecordData=True)
panel_2 = Panel(rec)
rec_2 = DataRecorder(DataLimit=-10, RecordData=True)
pythonremote = GHPythonRemote()
panel_3 = Panel(rec_2)

# ==== cluster GHPythonRemote: Connects the Grasshopper Python component to an external Python instance.
panel = Panel("C:\Users\henri\AppData\Roaming\Grasshopper\UserObjects\gh-python-remote\examples")
# GH to python remote example.
# Pierre Cuvilliers, 2017-2018
# Released under the MIT license
# github.com/pilcru/ghpythonremote
# Runs and connects to an external python engine, and
# assigns imported modules to scriptcontext.sticky variables.
# 
# Arguments:
#       code (str): Path to the GH_to_python_sticky.py code file.
#       location (str): Path to a python executable, or to a folder
#             containing `python.exe`, or the name of a conda-created
#             virtual environment prefixed by `conda://` (`conda://env_name`).
#             If empty, finds python from your windows %PATH%.
#       run (boolean): Creates the connection, and imports new
#             modules, when turned to True. Kills the connection,
#             and deletes the references to the imports, when turned
#             to False.
#       modules (str list): List of module names to import in the
#             remote python. They will be added to the
#             scriptcontext.sticky dictionary, allowing them to be
#             reused from other python components in the same
#             Grasshopper document. Submodules (for example
#             `numpy.linalg` have to be added explicitly to this list
#             to be available later.
#       log_level (str from ['NOTSET', 'DEBUG', 'INFO', 'WARNING', 'ERROR', 'CRITICAL']):
#             Logging level to use for the local IronPython and the
#             remote python instance.
#       working_dir (str): Working directory for the remote python
#             instance.
# 
# Returns:
#       out (str): Console output with DEBUG information.
#       linked_modules (str list): list of imported module names.
#       rpy (rpyc connection object): The object representing the
#             remote Python interpreter.
panel_2 = Panel("C:\ProgramData\Anaconda3\envs\rhinoremote")
panel_3 = Panel("""numpy
sklearn
sklearn.metrics
pandas""")
list = ValueList({"CRITICAL", "ERROR", "WARNING", "INFO", "DEBUG", "NOTSET"}, selected="DEBUG")
ghpythonremote = GHPythonRemote(location=panel_2, run=Toggle(True), modules=panel_3, log_level=list, working_dir=panel)  # -> out, linked_modules, rpy; inputs run: Boolean, modules: list
# ---------- ghpythonremote: Python ----------
import inspect
import logging
from os import path
import sys
from time import sleep

import scriptcontext

import ghpythonremote
from ghpythonremote.connectors import GrasshopperToPythonRemote

local_log_level = getattr(logging, log_level, logging.WARNING)
logger = logging.getLogger("ghpythonremote")
logger.setLevel(local_log_level)
ch = logging.StreamHandler()
ch.setLevel(local_log_level)
formatter = logging.Formatter("%(levelname)s: %(name)s:\n%(message)s")
ch.setFormatter(formatter)
logger.handlers = []
logger.addHandler(ch)
logger = logging.getLogger("ghpythonremote.GH_to_python")

ROOT = path.abspath(path.dirname(inspect.getfile(ghpythonremote)))
rpyc_server_py = path.join(ROOT, "pythonservice.py")

# Set connection to CLOSED if this is the first run
# and initialize set of linked modules
try:
    remote_python_status
except NameError:
    remote_python_status = "CLOSED"
    lkd_modules = set()

# Wait for connection to connect or terminate
timer = 0
while remote_python_status == "CONNECTING" or remote_python_status == "CLOSING":
    sleep(1)
    timer += 1
    if timer == 10:
        try:
            gh2py_manager.__exit__(*sys.exc_info())
        except Exception:
            pass
        remote_python_status = "CLOSED"
        lkd_modules = set()
        raise RuntimeError(
            "Connection left in an inconsistent state and not returning. Reset "
            "everything."
        )

if run:
    if not remote_python_status == "OPEN":
        remote_python_status = "CONNECTING"
        gh2py_manager = GrasshopperToPythonRemote(
            rpyc_server_py,
            location=location,
            timeout=10,
            port=None,
            log_level=log_level,
            working_dir=working_dir,
        )
        gh2py = gh2py_manager.__enter__()
        remote_python_status = "OPEN"

    # Stuff that we can reach
    rpymod = gh2py.py_remote_modules  # A getter function for a named python module
    rpy = gh2py.connection  # Represents the remote instance root object
    scriptcontext.sticky["rpy"] = rpy
    # Add modules
    for mod in modules:
        try:
            scriptcontext.sticky[mod] = rpymod(mod)
            lkd_modules.add(mod)
        except ImportError:
            gh2py_manager.__exit__(*sys.exc_info())
            raise

elif not remote_python_status == "CLOSED":
    remote_python_status = "CLOSING"
    # Remove linked modules
    for mod in lkd_modules:
        del scriptcontext.sticky[mod]
    del scriptcontext.sticky["rpy"]
    gh2py_manager.__exit__(*sys.exc_info())
    lkd_modules = set()
    remote_python_status = "CLOSED"

# Change variable name because ghpython resets outputs to None before each run
linked_modules = lkd_modules

logger.info("GH to python connection is {}".format(remote_python_status))
# ---------- end ghpythonremote ----------
panel_4 = Panel(ghpythonremote.out)
